# Grasshopper definition super_advanced_script.ghx (Grasshopper 0.9.76)

addition = Addition(A="1000", B="1000")
multiplication = Multiplication(A=addition, B=Slider(4, range=0..10))
panel = Panel(multiplication)
